# Dynamo graph Coordinate extraction.dyn "坐标提取7.25" (Dynamo 2.0.3.8810)

# group: 坐标提取
file_path = Filename("未选择文件。")
string = StringInput("sheeyt1;")
code_block = CodeBlock { 0; }
code_block_2 = CodeBlock { ["定位桩号","真实坐标"]; }
list_create = List.Create(item0=code_block_2)
flatten = List.Flatten(list=list_create)
categories = Categories(index=274)
all_elements_of_category = ElementsOfCategory(Category=categories)
string_2 = StringInput("标记")
getParameterValueByName = Element.GetParameterValueByName(element=all_elements_of_category, parameterName=string_2)
getLocation = Element.GetLocation(element=all_elements_of_category)
list_create_2 = List.Create(item0=getParameterValueByName, item1=getLocation)
transpose = List.Transpose(lists=list_create_2)
addItemToFront = List.AddItemToFront(item=flatten, list=transpose)
boolean = BoolSelector(true)
exportExcel = Data.ExportExcel(filePath=file_path, sheetName=string, startRow=code_block, startCol=code_block, data=addItemToFront, overWrite=boolean)
